# Grasshopper definition Singa_circular_district_Wallacei_FIN.gh (Grasshopper 1.0.7)
# Copyright:                       Milad Showkatbakhsh
# plug-ins: Bifocals, Wallacei, Shortest Walk in Gh, Kangaroo2 Components, Anemone, Mesh Pipe, Tarsier, Human, MeshEdit Components, Urbano

internalized_macpherson = Curve(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)
new_development_site = Curve(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)
genes = GenePool(
    Decimals=0,
    Maximum=20,
    Minimum=15,
    Value=[19.7545944, 19.04600882, 18.1099451, 15.40373076, 17.54332421, 19.5843527, 18.15918884, 16.72748161, 17.02124748, 19.71434954, 15.23471558, 19.00758594, 18.83582272, 16.48300494, 18.06673525, 19.53726032, 17.69761807, 17.32151289, 16.43142665, 17.79590326, 18.10049717, 19.53408121, 17.07432228, 16.61230547, 17.37375137, 15.17481526, 19.85802825, 16.39324138, 15.0448235, 18.24809047])
number_slider = Slider(12, range=5..12)
crv = Curve(new_development_site)

# ----
# option to move 0 point on curve
wlc_10_movearound = Slider(0.95, range=0..1)
cpoly = ControlPolygon(Curve=crv)  # -> Polygon, Points
seam = Seam(Curve=reparameterize(cpoly.Polygon), Seam=wlc_10_movearound)
divide = DivideCurve(Curve=seam, Count=4, Kinks=False)  # -> Points, Tangents, Parameters

pop2d = Populate2D(Region=crv, Count=Slider(36, range=30..60), Seed=1)
voronoi = Voronoi(Points=pop2d, BruteForceOverride=False)
rint = RegionIntersection(CurvesA=voronoi, CurvesB=crv)

# ----
# orient grid along one of sides
redpline = Reduce(Polyline=crv, Tolerance=3)  # -> Polyline, Reduction
explode = Explode(Curve=redpline.Polyline, Recursive=True)  # -> Segments, Vertices
len = Length(Curve=explode.Segments)
sort = SortList(Keys=len, ValuesA=explode.Segments)  # -> Keys, ValuesA
item = ListItem(List=reverse(sort.ValuesA), Index=0, Wrap=True)  # -> Item, Item1, Item2, Item3

redpline_2 = Reduce(Polyline=rint, Tolerance=Slider(1, range=0..1))  # -> Polyline, Reduction
cp = ControlPoints(Curve=redpline_2.Polyline)  # -> flatten(Points), Weights, Knots
duppt = RemoveDuplicatePts(Points=cp.Points, Tolerance=0.01)
cp_2 = ClosestPoint(Point=graft(divide.Points), Cloud=duppt)  # -> ClosestPoint, CPIndex, Distance
offset_l = OffsetCurveLoose(Curve=redpline_2.Polyline, Distance=expr("-x", genes))

# ----
# directions of alleys
pt = Point(flatten(cp_2.ClosestPoint))
item_2 = ListItem(List=pt, Index=0, Wrap=True)  # -> Item, Item1, Item2, Item3
ln = Line(StartPoint=item_2.Item, EndPoint=item_2.Item2)
ln_2 = Line(StartPoint=item_2.Item1, EndPoint=item_2.Item3)
merge = Merge(Data1=ln, Data2=ln_2)

# ----
# reduce outlayers
boundary = BoundarySurfaces(Edges=graft(offset_l))
area = Area(Geometry=boundary)  # -> Area, Centroid
sort_2 = SortList(Keys=area.Area, ValuesA=boundary)  # -> Keys, ValuesA
item_3 = ListItem(List=reverse(sort_2.ValuesA), Index=0, Wrap=True)  # -> simplify(Item)

filter = StreamFilter(Gate=Slider(0, range=0..3), Stream0=item.Item, Stream1=item.Item1, Stream2=item.Item2, Stream3=item.Item3)

# ----
# orient grid
crv_2 = Curve(filter)
midpt = CurveMiddle(Curve=crv_2)
rotate = Rotate(Geometry=crv_2, Angle=degrees("90"), Plane=midpt)  # -> Geometry, Transform
lnln = LineLine(LineA=crv_2, LineB=rotate.Geometry)

explode_2 = Explode(Curve=redpline_2.Polyline, Recursive=True)  # -> flatten(Segments), Vertices
panel = Panel("10")
dupln = RemoveDuplicateLines(Lines=explode_2.Segments, Tolerance=0.01)
flip = Flip(Surface=lnln)  # -> Surface, Result

# ----
# make grid of voxels and orient to centroid
dim = Dimensions(Surface=redpline.Polyline)  # -> UDimension, VDimension
area_2 = Area(Geometry=crv)  # -> Area, Centroid
int = Integer(dim.UDimension)
int_2 = Integer(dim.VDimension)
division = Division(A=int, B="10")
division_2 = Division(A=int_2, B=panel)
round = Round(Number=division)  # -> Nearest, Floor, Ceiling
round_2 = Round(Number=division_2)  # -> Nearest, Floor, Ceiling
panel_2 = Panel(round.Ceiling)
panel_3 = Panel(round_2.Ceiling)
multiplication = Multiplication(A=panel_2, B="10")
multiplication_2 = Multiplication(A=panel_3, B=panel)
division_3 = Division(A=multiplication, B=2)
division_4 = Division(A=multiplication_2, B=2)
dom = ConstructDomain(DomainStart=division_3, DomainEnd=expr("-x", division_3))
dom_2 = ConstructDomain(DomainStart=division_4, DomainEnd=expr("-x", division_4))
rectangle = Rectangle(Plane=flip.Surface, XSize=dom_2, YSize=dom, Radius=0)  # -> Rectangle, Length
area_3 = Area(Geometry=rectangle.Rectangle)  # -> Area, Centroid
orient = Orient(Geometry=rectangle.Rectangle, Source=area_3.Centroid, Target=area_2.Centroid)  # -> Geometry, Transform
mplane = MeshPlane(Boundary=orient.Geometry, WidthCount=panel_3, HeightCount=panel_2)  # -> Mesh, Area

shortwalk = ShortestWalk(Curves=dupln, WantedPath=merge)  # -> ShortestWalk, Succession, Direction, Length
previewlw = CustomPreviewLineweights(Geometry=shortwalk.ShortestWalk, Shader=ColourSwatch(SwatchColor=RGB(54, 45, 255)), Thickness="10", Absolute=False)

# ----
# select options for
# a square on
# the crossroads
dispatch = Dispatch(List=shortwalk.ShortestWalk, DispatchPattern=[True, False])  # -> ListA, ListB
area_4 = Area(Geometry=item_3)  # -> Area, flatten(Centroid)
ccx = CurveCurve(CurveA=dispatch.ListA, CurveB=dispatch.ListB)  # -> Points, ParamsA, ParamsB
cps = ClosestPoints(Point=ccx.Points, Cloud=area_4.Centroid, Count=Slider(3, range=1..5))  # -> flatten(ClosestPoint), CPIndex, Distance

# ----
# select square parcel
duppt_2 = RemoveDuplicatePts(Points=cps.ClosestPoint, Tolerance=0.01)
lng = ListLength(List=duppt_2)
panel_4 = Panel(lng)
item_4 = ListItem(List=duppt_2, Index=Slider(8, range=0..10), Wrap=True)

wlc_06_greenalley2 = Slider(15, range=15..40)
crv_3 = Curve(reparameterize(seam))

# ----
# exclude square
# from buildup area
incurve = PointInCurve(Point=item_4, Curve=flatten(item_3))  # -> Relationship, Point
cull = CullPattern(List=flatten(item_3), CullPattern=invert(incurve.Relationship))

# ----
# exclude popup factory
# from buildup area
wlc_07_add_green = PointOnCurve(crv_3, parameter=0.083)
cp_3 = ClosestPoint(Point=wlc_07_add_green, Cloud=area_4.Centroid)  # -> ClosestPoint, CPIndex, Distance
incurve_2 = PointInCurve(Point=cp_3.ClosestPoint, Curve=cull)  # -> Relationship, Point
cull_2 = CullPattern(List=flatten(cull), CullPattern=invert(incurve_2.Relationship))

wlc_08_randomreduce = Slider(7, range=1..9)
wlc_09_numreduce = Slider(2, range=1..5)
reduce = RandomReduce(List=cull_2, Reduction=wlc_09_numreduce, Seed=wlc_08_randomreduce)

# ----
# extract setbacks from parcels
# widening alleys
crv_4 = Curve(crv)
offset = OffsetCurve(Curve=crv_4, Distance=-5, Corners=1)
trim = TrimWithRegion(Curve=shortwalk.ShortestWalk, Region=offset)  # -> Inside, Outside
crv_5 = Curve(trim.Inside)
wlc_05_greenalley1 = Slider(18, range=15..40)
crv_6 = Curve(crv_5)
offset_2 = OffsetCurve(Curve=crv_6, Distance=expr("-x", wlc_06_greenalley2), Corners=1)  # -> flatten(Curve)
offset_3 = OffsetCurve(Curve=crv_6, Distance=wlc_05_greenalley1, Corners=1)  # -> flatten(Curve)
item_5 = ListItem(List=offset_3, Index=0, Wrap=True)  # -> Item, Item1
item_6 = ListItem(List=offset_2, Index=0, Wrap=True)  # -> Item, Item1
loft = Loft(
    Curves=[item_5.Item, item_6.Item],
    Options={Adjust=False, Closed=False, LoftEnds=0, LoftSimp=0, LoftType=0, Rebuild=10, Refit=0.01})
loft_2 = Loft(
    Curves=[item_5.Item1, item_6.Item1],
    Options={Adjust=False, Closed=False, LoftEnds=0, LoftSimp=0, LoftType=0, Rebuild=10, Refit=0.01})
runion = RegionUnion(Curves=[loft, loft_2])
rdiff = RegionDifference(CurvesA=reduce, CurvesB=runion)
boundary_2 = BoundarySurfaces(Edges=rdiff)

# ----
# extract pixels of mesh according parcels
mesh = Mesh(mplane.Mesh)
brep = Brep(boundary_2)
facen = FaceNormals(Mesh=mesh)  # -> Centers, Normals
pull = PullPoint(Point=facen.Centers, Geometry=brep, ClosestOnly=True)  # -> ClosestPoint, Distance
smaller = SmallerThan(FirstNumber=pull.Distance, SecondNumber=Slider(1, range=0..10))  # -> SmallerThan, OrEqualTo
cullf = CullFaces(Mesh=mesh, Pattern=invert(smaller.OrEqualTo))

item_7 = ListItem(Index=Slider(6, range=0..28), Wrap=True)  # disabled
mmergeex = MergeMeshEx(Mesh=cullf, Flip=False, AngleTolerance=0)
mesh_2 = Mesh(item_7)

# ----
# reduce voxels randomly
# (to be substituted by bioclimatic design conditions!!!)
explode_3 = MeshExplode(Mesh=mmergeex, Interpolate=False)  # -> simplify(Faces)
wlc_03_reducemesh = Slider(5, range=5..25)
wlc_11_randomesh = Slider(5, range=1..9)
lng_2 = ListLength(List=flatten(explode_3))
division_5 = Division(A=lng_2, B=wlc_03_reducemesh)
int_3 = Integer(division_5)
reduce_2 = RandomReduce(List=explode_3, Reduction=wlc_03_reducemesh, Seed=wlc_11_randomesh)  # -> simplify(List)

facen_2 = FaceNormals(Mesh=reduce_2)  # -> Centers, Normals
jitter = Jitter(List=facen_2.Centers, Jitter=1, Seed=Slider(81, range=1..305))  # -> Values, Indices
# attemp 2: build housings with anemone loop and noise
item_8 = ListItem(List=jitter.Values, Index=0, Wrap=True)

# ----
# reorient plane
srf = Surface(orient.Geometry)
xy = XYPlane(Origin=item_8)
deplane = DeconstructPlane(Plane=xy)  # -> Origin, XAxis, YAxis, ZAxis
deplane_2 = DeconstructPlane(Plane=srf)  # -> Origin, XAxis, YAxis, ZAxis
angle = Angle(VectorA=deplane_2.YAxis, VectorB=deplane.YAxis)  # -> Angle, Reflex

# ----
# GFA limit,
# Singapore density = 8358 persons/ km2
# average apartment sqm/ person = 30 sqm
area_5 = Area(Geometry=boundary_2)  # -> Area, Centroid
ma = MassAddition(Input=area_5.Area)  # -> Result, PartialResults
panel_5 = Panel(ma.Result)

area_6 = Area(Geometry=crv)  # -> Area, Centroid
panel_6 = Panel(area_6.Area)
division_6 = Division(A=panel_6, B="1000000")
multiplication_3 = Multiplication(A="8358", B=division_6)
average_population = Panel(multiplication_3)

prot = RotatePlane(Plane=item_8, Angle=angle.Angle)  # disabled
pt_2 = Point(area_5.Centroid)
# next step - integrate with anemone and growing voxels as bridges
output = DataOutput(
    DataInput=prot,
    Destination="C:\WORK_IAAC\submissions\Internet of Buildings\IoB_WIP\IoB_GH\plane_dest.ghdata",
    RelativePath="C:\WORK_IAAC\submissions\Internet of Buildings\IoB_WIP\IoB_GH\plane_dest.ghdata|plane_dest.ghdata")
multiply_ratio = Panel("3")
of_footprint_aim = Panel("10")
area_7 = Area(Geometry=cullf)  # -> Area, Centroid

# ----
# model loft buildings
tstat = TreeStatistics(Tree=reduce_2)  # -> Paths, Length, Count
level_height = Panel("3")
series = Series(Start=0, Step=level_height, Count=tstat.Length)
Z = UnitZ(Factor=series)
move = Move(Geometry=reduce_2, Motion=simplify(Z))  # -> Geometry, Transform
faceb = FaceBoundaries(Mesh=move.Geometry)
faceb_2 = FaceBoundaries(Mesh=reduce_2)
merge_2 = Merge(Data1=faceb_2, Data2=faceb)

actual_footprint = Panel(area_7.Area)
num = Number(expr("x/100", of_footprint_aim))
multiplication_4 = Multiplication(A=actual_footprint, B=num)
footprint_aim = Panel(multiplication_4)
minfoot = Number(footprint_aim)
embedded_co2 = Panel("""50
150
550""")
loft_3 = Loft(Curves=merge_2, Options={Adjust=False, Closed=False, LoftEnds=0, LoftSimp=0, LoftType=0, Rebuild=10, Refit=0.01})
cap = CapHoles(Brep=loft_3)
medges = MeshEdges(Mesh=cap)  # -> NakedEdges, InteriorEdges, NonManifoldEdges
meta = CreateMetadata(KeysInMetadata=["name", "untrimmed surface", "closed brep"], ValuesInMetadata=embedded_co2)

# ----
# selecting house heights
area_8 = Area(Geometry=faceb_2)  # -> Area, Centroid
area_9 = Area(Geometry=faceb)  # -> Area, Centroid
ln_3 = Line(StartPoint=area_8.Centroid, EndPoint=area_9.Centroid)
trim_2 = TrimTree(Tree=ln_3, Depth=1)
len_2 = Length(Curve=trim_2)
panel_7 = Panel(Slider(48, range=10..90))
larger = LargerThan(FirstNumber=len_2, SecondNumber=panel_7)  # -> LargerThan, OrEqualTo
cull_3 = CullPattern(List=trim_2, CullPattern=larger.OrEqualTo)

preview = CustomPreview(Material=ColourSwatch(SwatchColor=RGB(255, 255, 255)))
previewlw_2 = CustomPreviewLineweights(Geometry=medges.InteriorEdges, Shader=ColourSwatch(SwatchColor=RGB(12, 21, 0)), Thickness="0.1", Absolute=False)
preview_2 = CustomPreview(Geometry=cap, Material=ColourSwatch(SwatchColor=RGB(255, 255, 255)))
preview_3 = CustomPreview(Geometry=redpline_2.Polyline, Material=ColourSwatch(SwatchColor=RGB(238, 19, 122)))
previewlw_3 = CustomPreviewLineweights(Shader=ColourSwatch(SwatchColor=RGB(119, 122, 161)), Thickness="0.1", Absolute=False)
geo = Geometry(reduce_2)

tstat_2 = TreeStatistics()  # -> Paths, Length, Count
smaller_2 = SmallerThan(FirstNumber=tstat_2.Length, SecondNumber="12")  # -> SmallerThan, OrEqualTo
larger_2 = LargerThan(FirstNumber=tstat_2.Length, SecondNumber="3")  # -> LargerThan, OrEqualTo
and = GateAnd(A=larger_2.LargerThan, B=smaller_2.SmallerThan)
cull_4 = CullPattern(List=tstat_2.Paths, CullPattern=and)
branch = TreeBranch(Path=cull_4, MaintainPaths=True)
python = GhPythonScript(x=cull_4)  # -> out, flatten(a)
# ---------- python: Python ----------
import re 
a = re.findall(r'[0-9.]+', x)
# ---------- end python ----------
panel_8 = Panel(branch)
replace = ReplaceItems(Indices=python.a, Wrap=False)

volume = Volume(Geometry=flatten(cap))  # -> Volume, Centroid
avr = Average(Input=volume.Volume)
one_over_x = OneOverX(Value=avr)
wlc_0_max_vol = Number(flatten(one_over_x))

# ----
# select iterative levels
len_3 = Length(Curve=cull_3)
level_incre = Panel("12")
min_height = Panel("15")
subtraction = Subtraction(A=len_3, B=min_height)
cull_5 = CullPattern(List=geo, CullPattern=larger.OrEqualTo)
division_7 = Division(A=subtraction, B=level_incre)
series_2 = Series(Start=min_height, Step=level_incre, Count=division_7)
Z_2 = UnitZ(Factor=series_2)
move_2 = Move(Geometry=graft(cull_5), Motion=Z_2)  # -> Geometry, Transform
trim_3 = TrimTree(Tree=move_2.Geometry, Depth=1)
facen_3 = FaceNormals(Mesh=trim_3)  # -> Centers, Normals
panel_9 = Panel("20")
pdecon = Deconstruct(Point=facen_3.Centers)  # -> XComponent, YComponent, ZComponent
cset = CreateSet(List=flatten(pdecon.ZComponent))  # -> Set, Map
panel_10 = Panel(cset.Set)
item_9 = ListItem(List=panel_10, Index=Slider(0, range=0..10), Wrap=True)
equals = Equality(FirstNumber=pdecon.ZComponent, SecondNumber=item_9)  # -> Equality, Inequality
cull_6 = CullPattern(List=facen_3.Centers, CullPattern=equals.Equality)
trim_4 = TrimTree(Tree=cull_6, Depth=1)

reldif = RelativeDifferences(Values=flatten(len_2))
abs = Absolute(Value=reldif)
avr_2 = Average(Input=abs)
one_over_x_2 = OneOverX(Value=avr_2)
wlc_1_height_dif = Number(flatten(one_over_x_2))

# ----
# connect tops only
end = EndPoints(Curve=cull_3)  # -> Start, End
del = DelaunayMesh(Points=end.End, Plane=PlaneXY(0, 0, 0))
medges_2 = MeshEdges(Mesh=del)  # -> NakedEdges, InteriorEdges, NonManifoldEdges
crv_7 = Curve([medges_2.InteriorEdges, medges_2.NakedEdges])

del_2 = DelaunayMesh(Points=trim_4, Plane=PlaneXY(0, 0, 0))
geo_2 = Geometry(cap)
medges_3 = MeshEdges(Mesh=del_2)  # -> NakedEdges, InteriorEdges, NonManifoldEdges
wallacei_x = WallaceiX(
    Genes=[wlc_03_reducemesh, wlc_05_greenalley1, wlc_06_greenalley2, wlc_08_randomreduce, wlc_09_numreduce, wlc_10_movearound, wlc_11_randomesh],
    Objectives=[wlc_0_max_vol, wlc_1_height_dif],
    Phenotype=geo_2,
    allFitness="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",
    allFrontIdx="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",
    allGenomes="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",
    curFrontIdx="49|0;49|1;49|2;49|3;49|4;49|5;49|6;49|7;49|8;49|9;49|10;49|11;49|12;49|13;49|14;49|15;49|16;49|17;49|18;49|19",
    curFrontIdxSave="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",
    popGen="20,50",
    total="5639781",
    wlcDone=True)  # -> WallaceiGenomes, FitnessValues, Data, WPhenotypes
item_10 = ListItem(List=flatten(wallacei_x.WPhenotypes), Index=Slider(60, range=0..60), Wrap=True)
distributor = DistributeToGrid(
    FitnessValues=wallacei_x.FitnessValues,
    WallaceiPhenotypes=wallacei_x.WPhenotypes,
    SizeOfTheGridInTheXDirection=Slider(79, range=50..200),
    SizeOfTheGridInTheYDirection=Slider(72, range=50..200),
    OutputOptions=0)  # -> DistributedFitnessValues, DistributedData, DistributedGeometries, DistributedMeshes, DistributedNumbers, GridLocations
pdecoder = DecodePhenotype(WallaceiPhenotype=item_10)  # -> GeometriesList, MeshesList, NumbersList, TextList
medges_4 = MeshEdges(Mesh=pdecoder.MeshesList)  # -> NakedEdges, flatten(InteriorEdges), NonManifoldEdges
previewlw_4 = CustomPreviewLineweights(Geometry=medges_4.InteriorEdges, Shader=ColourSwatch(SwatchColor=RGB(235, 41, 255)), Absolute=False)
previewlw_5 = CustomPreviewLineweights(Geometry=rdiff, Shader=ColourSwatch(SwatchColor=RGB(51, 50, 255)), Thickness=Slider(0.1, range=0.1..1), Absolute=False)

# ----
# Creating aggregation (Growth direction from imposed directions) + relation with environment + optimization
number_slider_2 = Slider(30, range=0..100)
neg = Negative(Value=number_slider_2)
number_slider_3 = Slider(100, range=0..100)
dom_3 = ConstructDomain(DomainStart=number_slider_2, DomainEnd=neg)
rectangle_2 = Rectangle(Plane=item_8, XSize=dom_3, YSize=dom_3, Radius=0)  # -> Rectangle, Length
mplane_2 = MeshPlane(Boundary=rectangle_2.Rectangle, WidthCount=number_slider_3, HeightCount=number_slider_3)  # -> Mesh, Area
pt_3 = Point(prot)
loop_start = LoopStart(N=Slider(180, range=0..270), T=Button(), aggregation=pt_3, environment=mesh_2)  # -> port, Counter, Data, Data_2, Data_3; disabled
panel_11 = Panel("""0,0,3
0,5,0
5,0,0
0,0,-3
0,-5,0
-5,0,0""")
addition = Addition(A=loop_start.Data_3, B=Slider(0, range=0..0.11))
panel_12 = Panel(loop_start.Counter)
move_3 = Move(Geometry=loop_start.Data, Motion=graft(panel_11))  # -> flatten(Geometry), Transform
cluster = Cluster(mesh=loop_start.Data_2, t=addition, S=Slider(1, range=0..1))
difference = SetDifference(SetA=move_3.Geometry, SetB=loop_start.Data)
mesh_3 = Mesh(cluster)
demesh = DeconstructMesh(Mesh=mesh_3)  # -> Vertices, Faces, Colours, Normals
pdecon_2 = Deconstruct(Point=difference)  # -> XComponent, YComponent, ZComponent
smaller_3 = SmallerThan(FirstNumber=pdecon_2.ZComponent, SecondNumber="0")  # -> SmallerThan, OrEqualTo
dispatch_2 = Dispatch(List=difference, DispatchPattern=smaller_3.SmallerThan)  # -> ListA, ListB
construct = ConstructPointCloud(Points=demesh.Vertices)
kdconstruct = ConstructKDTree(PointCloud=construct)
kdsample = SampleKDTree(KDTree=kdconstruct, Points=dispatch_2.ListB, Range="999", MaximumPointsReturned=Slider(1, range=0..1))  # -> flatten(Indices)
item_11 = ListItem(List=demesh.Colours, Index=kdsample, Wrap=True)
item_12 = ListItem(List=demesh.Vertices, Index=kdsample, Wrap=True)
dist = Distance(PointA=dispatch_2.ListB, PointB=item_12)
number_slider_4 = Slider(50, range=0..100)
bnd = Bounds(Numbers=dist)
remap = RemapNumbers(Value=dist, Source=bnd, Target=Domain(0, 1))  # -> Mapped, Clipped
graph = GraphMapper(
    remap.Mapped,
    x0=0,
    x1=1,
    y0=0,
    y1=1,
    container_name="Bezier",
    cpx=[0, 0.9690489769, 0.8695651889, 1],
    cpy=[0.09327942133, 0.1399633288, 0.4637681246, 0.9727517962])
argb = SplitARGB(Colour=item_11)  # -> Alpha, Red, Green, Blue
multiplication_5 = Multiplication(A=argb.Blue, B=graph)
sort_3 = SortList(Keys=multiplication_5, ValuesA=dispatch_2.ListB)  # -> Keys, ValuesA
split = SplitList(List=sort_3.ValuesA, Index=Slider(10, range=0..10))  # -> ListA, ListB
jitter_2 = Jitter(List=split.ListA, Jitter=1, Seed=2)  # -> Values, Indices
split_2 = SplitList(List=jitter_2.Values, Index=Slider(3, range=0..10))  # -> ListA, ListB
merge_3 = Merge(Data1=flatten(loop_start.Data), Data2=flatten(split_2.ListA))
cullpt = CullDuplicates(Points=merge_3, Tolerance=0.1, CullMode=1)  # -> Points, Indices, Valence

# ---- group: Loop End
running = Running(
    port=loop_start.port,
    Exit=False,
    Data=cullpt.Points,
    Data_2=cluster,
    Data_3=addition,
    TimeOutVal=0,
    pausedState=False,
    state="Constant output")  # -> D0, D1, D2

# ----
voxel = Voxel(Points=running.D0, X=1, Y=1, Z=1)

# ----
# GFA calculation
multiplication_6 = Multiplication(A=average_population, B="30")
num_2 = Number(expr("int(x)", multiplication_6))
of_other_functions = Panel("40")
num_3 = Number(expr("x/100+1", of_other_functions))

multiplication_7 = Multiplication(A=num_2, B=multiply_ratio)

approx_residential_stock = Panel(multiplication_7)
multiplication_8 = Multiplication(A=approx_residential_stock, B=num_3)
approx_gfa = Panel(multiplication_8)

division_8 = Division(A=approx_gfa, B=footprint_aim)
maxgfa = Number(approx_gfa)
average_levels = Panel(division_8)

# ==== cluster Cluster
mesh = ClusterInput()
mesh_2 = Mesh(mesh)
number_slider = Slider(0.3, range=0..1)
demesh = DeconstructMesh(Mesh=mesh_2)  # -> Vertices, Faces, Colours, Normals
input = DataInput(
    Destination="C:\WORK_IAAC\submissions\Internet of Buildings\IoB_WIP\IoB_GH\plane_dest.ghdata",
    RelativePath="C:\WORK_IAAC\submissions\Internet of Buildings\IoB_WIP\IoB_GH\plane_dest.ghdata",
    UpdateDelay=50000)
scale_nu = ScaleNU(Geometry=mesh_2, Plane=PlaneXY(0, 0, 0), ScaleX="1", ScaleY="1", ScaleZ="3")  # -> Geometry, Transform
demesh_2 = DeconstructMesh(Mesh=scale_nu.Geometry)  # -> Vertices, Faces, Colours, Normals
t = ClusterInput()
S = ClusterInput()
perlin = PerlinNoise(Values=demesh_2.Vertices, Time=t, Scale=S)
gradient = Gradient(LowerLimit="-1", UpperLimit=1, Parameter=perlin, stops=[0: RGB(255, 255, 255), 1: RGB(0, 0, 0)])
conmesh = ConstructMesh(Vertices=demesh.Vertices, Faces=demesh.Faces, Colours=gradient)
M = ClusterOutput(conmesh)
